# Grasshopper definition Boundary_to_Excel.gh (Grasshopper 1.0.7)
# plug-ins: LunchBox

height = Panel("300")
length = Panel("2100")
width = Panel("400")
dom = ConstructDomain(DomainStart="0", DomainEnd="20")
division = Division(A=length, B="20")
division_2 = Division(A=height, B="20")
division_3 = Division(A=width, B="20")
rectangle = Rectangle(Plane=PlaneXY(0, 0, 0), XSize=dom, YSize=dom, Radius=0)  # -> Rectangle, Length
multiplication = Multiplication(A=division, B=division_3, C=division_2)
addition = Addition(A=division_2, B="1")
addition_2 = Addition(A=division, B="1")
addition_3 = Addition(A=division_3, B="1")
element_count = Panel(multiplication)
pt = ConstructPoint(XCoordinate=0, YCoordinate=0, ZCoordinate=0)
boxrec = BoxRectangle(Rectangle=rectangle.Rectangle, Height="20")
neg = Negative(Value=addition)
arrbox = BoxArray(Geometry=pt, Cell=boxrec, XCount=addition_2, YCount=addition_3, ZCount=neg)  # -> Geometry, Transform
partition = PartitionList(List=arrbox.Geometry, Size=addition_2)

panel = Panel("C:\Users\Eva Schoenmaker\OneDrive - Delft University of Technology\Thesis\08_Rhino\Data_setup_full.xlsx")
toggle = BooleanToggle(True)  # disabled
panel_2 = Panel("""d_FE
Length
Width 
Height""")
entwine = Entwine(Branch00="20", Branch01=length, Branch02=width, Branch03=height, FlattenInputs=True)
excelwrite = ExcelWrite(WriteExcelData=toggle, WorkbookPath=panel, WorksheetName="Data", ColumnHeadings=panel_2, Data=entwine, ClearSheet=False)

python = GhPythonScript(
    x=flatten(partition),
    d_FE="20",
    x_ub=Slider(139, range=0..150),
    x_lb=Slider(0, range=0..50),
    y_ub=Slider(20, range=0..20),
    y_lb=Slider(20, range=0..20),
    z_ub=Slider(40, range=0..50),
    z_lb=Slider(0, range=0..10))  # -> out, nodes_xyz; inputs x: list of Point3d, d_FE: Int32, x_ub: Int32, x_lb: Int32
# ---------- python: Python ----------
__author__ = "Eva Schoenmaker"
__version__ = "2023.10.16"

import rhinoscriptsyntax as rs
nodes_x = []
for i in range(0, len(x)):
    coords = x[i]
    if x_lb*d_FE <= coords[0] <= x_ub*d_FE:
         nodes_x.append(coords)

nodes_xy = []
for i in range(0, len(nodes_x)):
    coords = nodes_x[i]
    if y_lb*d_FE <= coords[1] <= y_ub*d_FE:
        nodes_xy.append(coords)

nodes_xyz = []
for i in range(0, len(nodes_xy)):
    coords = nodes_xy[i]
    if z_ub*d_FE*-1 <= coords[2] <= z_lb*d_FE*-1:
        nodes_xyz.append(coords)
print(nodes_xyz)
# ---------- end python ----------
pt_2 = Point(python.nodes_xyz)
pdecon = Deconstruct(Point=pt_2)  # -> XComponent, YComponent, ZComponent
panel_3 = Panel("""supports x
supports y
supports z""")
entwine_2 = Entwine(Branch00=pdecon.XComponent, Branch01=pdecon.YComponent, Branch02=pdecon.ZComponent, FlattenInputs=True)
excelwrite_2 = ExcelWrite(
    WriteExcelData=toggle,
    WorkbookPath=panel,
    WorksheetName="Supports_mirror_y",
    ColumnHeadings=panel_3,
    Data=entwine_2,
    ClearSheet=False)

python_2 = GhPythonScript(
    x=flatten(partition),
    d_FE="20",
    x_ub=Slider(105, range=0..150),
    x_lb=Slider(105, range=0..150),
    y_ub=Slider(20, range=0..20),
    y_lb=Slider(0, range=0..10),
    z_ub=Slider(16, range=0..20),
    z_lb=Slider(0, range=0..10))  # -> out, nodes_xyz; inputs x: list of Point3d, d_FE: Int32, x_ub: Int32, x_lb: Int32; same code as python
pt_3 = Point(python_2.nodes_xyz)
pdecon_2 = Deconstruct(Point=pt_3)  # -> XComponent, YComponent, ZComponent
panel_4 = Panel("""supports x
supports y
supports z""")
entwine_3 = Entwine(Branch00=pdecon_2.XComponent, Branch01=pdecon_2.YComponent, Branch02=pdecon_2.ZComponent, FlattenInputs=True)
excelwrite_3 = ExcelWrite(
    WriteExcelData=toggle,
    WorkbookPath=panel,
    WorksheetName="Supports_mirror_x",
    ColumnHeadings=panel_4,
    Data=entwine_3,
    ClearSheet=False)

python_3 = GhPythonScript(
    x=flatten(partition),
    d_FE="20",
    x_ub=Slider(4, range=0..30),
    x_lb=Slider(0, range=0..10),
    y_ub=Slider(20, range=0..20),
    y_lb=Slider(0, range=0..10),
    z_ub=Slider(15, range=0..50),
    z_lb=Slider(15, range=0..50))  # -> out, nodes_xyz; inputs x: list of Point3d, d_FE: Int32, x_ub: Int32, x_lb: Int32; same code as python
pt_4 = Point(python_3.nodes_xyz)
pdecon_3 = Deconstruct(Point=pt_4)  # -> XComponent, YComponent, ZComponent
panel_5 = Panel("""supports x
supports y
supports z""")
entwine_4 = Entwine(Branch00=pdecon_3.XComponent, Branch01=pdecon_3.YComponent, Branch02=pdecon_3.ZComponent, FlattenInputs=True)
excelwrite_4 = ExcelWrite(
    WriteExcelData=toggle,
    WorkbookPath=panel,
    WorksheetName="Supports_fixed_z",
    ColumnHeadings=panel_5,
    Data=entwine_4,
    ClearSheet=False)

python_4 = GhPythonScript(
    x=flatten(partition),
    d_FE="20",
    x_ub=Slider(0, range=0..30),
    x_lb=Slider(0, range=0..10),
    y_ub=Slider(20, range=0..20),
    y_lb=Slider(0, range=0..10),
    z_ub=Slider(15, range=0..50),
    z_lb=Slider(11, range=0..50))  # -> out, nodes_xyz; inputs x: list of Point3d, d_FE: Int32, x_ub: Int32, x_lb: Int32; same code as python
pt_5 = Point(python_4.nodes_xyz)
pdecon_4 = Deconstruct(Point=pt_5)  # -> XComponent, YComponent, ZComponent
panel_6 = Panel("""supports x
supports y
supports z""")
entwine_5 = Entwine(Branch00=pdecon_4.XComponent, Branch01=pdecon_4.YComponent, Branch02=pdecon_4.ZComponent, FlattenInputs=True)
excelwrite_5 = ExcelWrite(
    WriteExcelData=toggle,
    WorkbookPath=panel,
    WorksheetName="Supports_fixed_x",
    ColumnHeadings=panel_6,
    Data=entwine_5,
    ClearSheet=False)

python_5 = GhPythonScript(
    x=flatten(partition),
    d_FE="20",
    x_ub=Slider(105, range=0..150),
    x_lb=Slider(0, range=0..50),
    y_ub=Slider(20, range=0..20),
    y_lb=Slider(0, range=0..10),
    z_ub=Slider(0, range=0..20),
    z_lb=Slider(0, range=0..20))  # -> out, nodes_full, nodes_middle, nodes_sides; inputs x: list of Point3d, d_FE: Int32, x_ub: Int32, x_lb: Int32
# ---------- python_5: Python ----------
__author__ = "Eva Schoenmaker"
__version__ = "2023.10.16"

import rhinoscriptsyntax as rs
nodes_x = []
for i in range(0, len(x)):
    coords = x[i]
    if x_lb*d_FE <= coords[0] <= x_ub*d_FE:
         nodes_x.append(coords)

nodes_xy = []
for i in range(0, len(nodes_x)):
    coords = nodes_x[i]
    if y_lb*d_FE <= coords[1] <= y_ub*d_FE:
        nodes_xy.append(coords)

nodes_full = []
for i in range(0, len(nodes_xy)):
    coords = nodes_xy[i]
    if z_ub*d_FE*-1 <= coords[2] <= z_lb*d_FE*-1:
        nodes_full.append(coords)


nodes_x = []
for i in range(0, len(x)):
    coords = x[i]
    if (x_lb+1)*d_FE <= coords[0] <= (x_ub-1)*d_FE:
         nodes_x.append(coords)

nodes_xy = []
for i in range(0, len(nodes_x)):
    coords = nodes_x[i]
    if (y_lb+1)*d_FE <= coords[1] <= (y_ub-1)*d_FE:
        nodes_xy.append(coords)

nodes_middle = []
for i in range(0, len(nodes_xy)):
    coords = nodes_xy[i]
    if z_ub*d_FE*-1 <= coords[2] <= z_lb*d_FE*-1:
        nodes_middle.append(coords)

nodes_sides = []
for i in range(0, len(nodes_full)):
    if nodes_full[i] not in nodes_middle:
        nodes_sides.append(nodes_full[i])
# ---------- end python_5 ----------
pt_6 = Point(python_5.nodes_middle)
panel_7 = Panel("""supports x
supports y
supports z""")
pdecon_5 = Deconstruct(Point=pt_6)  # -> XComponent, YComponent, ZComponent
entwine_6 = Entwine(Branch00=pdecon_5.XComponent, Branch01=pdecon_5.YComponent, Branch02=pdecon_5.ZComponent, FlattenInputs=True)
excelwrite_6 = ExcelWrite(
    WriteExcelData=toggle,
    WorkbookPath=panel,
    WorksheetName="Loads_middle",
    ColumnHeadings=panel_7,
    Data=entwine_6,
    ClearSheet=False)

pt_7 = Point(python_5.nodes_sides)

pdecon_6 = Deconstruct(Point=pt_7)  # -> XComponent, YComponent, ZComponent
entwine_7 = Entwine(Branch00=pdecon_6.XComponent, Branch01=pdecon_6.YComponent, Branch02=pdecon_6.ZComponent, FlattenInputs=True)
excelwrite_7 = ExcelWrite(
    WriteExcelData=toggle,
    WorkbookPath=panel,
    WorksheetName="Loads_sides",
    ColumnHeadings=panel_7,
    Data=entwine_7,
    ClearSheet=False)
