# Grasshopper definition Excel_to_Geometry.gh (Grasshopper 1.0.7)
# plug-ins: LunchBox, Weaverbird

panel = Panel("C:\Users\Eva Schoenmaker\OneDrive - Delft University of Technology\Thesis\03_Matlab\10_Creating_plots\DHPC_excels\Results\230914_case_3D_V_obj_ALL_q_2.8_av_3.5_Vi_0.6\230914_case_3D_V_obj_ALL_q_2.8_av_3.5_Vi_0.6.xlsx")
excelread = ExcelReader(ReadExcelData=Toggle(True), WorkbookPath=panel, WorksheetName="Sheet1")  # -> Exceptions, ExcelData
item = ListItem(List=excelread.ExcelData, Index="1", Wrap=True)  # -> flatten(Item)
item_2 = ListItem(List=excelread.ExcelData, Index="0", Wrap=True)  # -> flatten(Item)
python = GhPythonScript(var_name=item_2, var_value=item)  # -> FE, nelx, nely, nelz; inputs var_name: list, var_value: list
# ---------- python: Python ----------
"""Provides a scripting component.
    Inputs:
        var_name: The names of the variable
        var_value: the value of the corrosponding variable
    Output:
        FE: size of finite element [m]
        nelx: number of elements in x direction
        nely: number of elements in y direction
        nelz: number of elements in z direction"""

__author__ = "Eva Schoenmaker"
__version__ = "2023.06.12"

import rhinoscriptsyntax as rs

for i in range(len(var_value)):
    if var_name[i] == 'd_FE_L':
        FE = var_value[i]
    elif var_name[i] == 'nelx_L':
        nelx = var_value[i]
    elif var_name[i] == 'nely_L':
        nely = var_value[i]
    elif var_name[i] == 'nelz_L':
        nelz = var_value[i]
# ---------- end python ----------

# ---- group: Full domain
python_2 = GhPythonScript(nelx=python.nelx, nely=python.nely, nelz=python.nelz, d_FE=python.FE)  # -> out, x_coord, y_coord, z_coord; inputs nelx: Int32, nely: Int32, nelz: Int32, d_FE: Int32
# ---------- python_2: Python ----------
__author__ = "Eva Schoenmaker"
__version__ = "2023.06.12"

import rhinoscriptsyntax as rs

x_coord = []
y_coord = []
z_coord = []
for x in range(nelx):
    for y in range(nely):
        for z in range(nelz):
            x_coord.append(x*d_FE +d_FE)
            y_coord.append(-1*y*d_FE -d_FE)
            z_coord.append(-1*z*d_FE -d_FE)


"""for z in range(nelz-1):
    for x in range(nelx -1):
        for y in range(nely - 1):
            y_coord.append(x)

print(y_coord)

print(a)"""
# ---------- end python_2 ----------
python_3 = GhPythonScript(nelx=python.nelx, nely=python.nely, nelz=python.nelz, d_FE=python.FE)  # -> out, x_coord, y_coord, z_coord; inputs nelx: Int32, nely: Int32, nelz: Int32, d_FE: Int32
# ---------- python_3: Python ----------
__author__ = "Eva Schoenmaker"
__version__ = "2023.06.12"

import rhinoscriptsyntax as rs

x_coord = []
y_coord = []
z_coord = []
for x in range(nelx):
    for y in range(nely):
        for z in range(nelz):
            x_coord.append(x*d_FE)
            y_coord.append(y*d_FE*-1)
            z_coord.append(-1*z*d_FE)


"""for z in range(nelz-1):
    for x in range(nelx -1):
        for y in range(nely - 1):
            y_coord.append(x)

print(y_coord)

print(a)"""
# ---------- end python_3 ----------
pt = ConstructPoint(XCoordinate=python_3.x_coord, YCoordinate=python_3.y_coord, ZCoordinate=python_3.z_coord)
pt_2 = ConstructPoint(XCoordinate=python_2.x_coord, YCoordinate=python_2.y_coord, ZCoordinate=python_2.z_coord)
box = Box2Pt(PointA=pt, PointB=pt_2, Plane=PlaneXY(0, 0, 0))
brep = Brep(graft(box))

# ---- group: splitting to more then 30% and colouring
split = SplitList(List=excelread.ExcelData, Index=Slider(2, range=0..3))  # -> ListA, ListB
multiplication = Multiplication(A=python.nelx, B=python.nely, C=python.nelz)
split_2 = SplitList(List=flatten(split.ListB), Index=multiplication)  # -> ListA, ListB
gradient = Gradient(
    LowerLimit=0,
    UpperLimit=1,
    Parameter=split_2.ListA,
    stops=[0: RGB(93, 134, 117), 0: RGB(221, 121, 125), 0: RGB(18, 167, 83), 0.107: RGB(255, 255, 255), 1: RGB(0, 0, 0)])
python_4 = GhPythonScript(x=split_2.ListA)  # -> out, index; inputs x: list
# ---------- python_4: Python ----------
__author__ = "Eva Schoenmaker"
__version__ = "2023.06.12"

import rhinoscriptsyntax as rs
index = []
for i in range(len(x)):
    if x[i] >= 0.3:
        index.append(i)
# ---------- end python_4 ----------
item_3 = ListItem(List=flatten(brep), Index=python_4.index, Wrap=True)  # -> graft(Item)
item_4 = ListItem(List=gradient, Index=python_4.index, Wrap=True)
mcol = MeshColours(Mesh=item_3, Colours=graft(item_4))  # -> flatten(Mesh)

# ----
pt_3 = ConstructPoint(XCoordinate=0, YCoordinate=0, ZCoordinate=0)
panel_2 = Panel(pt)
multiplication_2 = Multiplication(A=python.nelx, B=python.FE)
multiplication_3 = Multiplication(A=python.nely, B=-1, C=python.FE)

# ---- group: Mirror y
pt_4 = ConstructPoint(XCoordinate=multiplication_2, YCoordinate=multiplication_3, ZCoordinate=0)
vec = VectorXYZ(XComponent=0, YComponent=0, ZComponent="1")  # -> Vector, Length
pl = ConstructPlane(Origin=pt_4, XAxis=Vector(1, 0, 0), YAxis=vec.Vector)
mirror = Mirror(Geometry=flatten(mcol), Plane=pl)  # -> Geometry, Transform

# ----
multiplication_4 = Multiplication(A=python.nely, B=-1)

# ---- group: Mirror x
vec_2 = VectorXYZ(XComponent=0, YComponent="1", ZComponent=0)  # -> Vector, Length
pl_2 = ConstructPlane(Origin=pt_4, XAxis=vec_2.Vector, YAxis=vec.Vector)
mirror_2 = Mirror(Geometry=flatten([mcol, mirror.Geometry]), Plane=pl_2)  # -> graft(Geometry), Transform

# ---- group: Geometry as Mesh
wbjoin = WeaverbirdsJoinMeshesAndWeld(Mesh=flatten([item_3, mirror.Geometry, mirror_2.Geometry]), Weld=False)

# ---- group: Drawing outline wires
wires = BrepWireframe(Brep=item_3, Density=-1)

pt_5 = ConstructPoint(XCoordinate=python.nelx, YCoordinate=multiplication_4, ZCoordinate=0)
vec_3 = VectorXYZ(XComponent=0, YComponent=0, ZComponent="1")  # -> Vector, Length
pl_3 = ConstructPlane(Origin=pt_5, XAxis=Vector(1, 0, 0), YAxis=vec_3.Vector)
mirror_3 = Mirror(Geometry=flatten(wires), Plane=pl_3)  # -> graft(Geometry), Transform

preview = CustomPreview(Geometry=[wires, mirror_3.Geometry], Material=ColourSwatch(SwatchColor=RGB(43, 43, 43)))
